# Grasshopper definition crystal-vase.gh (Grasshopper 1.0.7)
# plug-ins: GhPolyhedra

polyhedra_names = PolyhedraNames(Category="Archimedean Solids")
panel = Panel(polyhedra_names)
item = ListItem(List=panel, Index=Slider(13, range=0..15), Wrap=True)
thickness = Slider(1.09, range=1..2)
polyhedron = Polyhedron(Name=item, Plane=PlaneXY(0, 0, 0), Scale=Slider(13, range=1..20))  # -> Curves, Meshes, Solid
index_to_remove = Slider(8, range=0..50)
scale = Scale(Geometry=polyhedron.Curves, Center=Point(0, 0, 0), Factor=thickness)  # -> Geometry, Transform
boundary = BoundarySurfaces(Edges=polyhedron.Curves)
boundary_2 = BoundarySurfaces(Edges=scale.Geometry)
cull_i = CullIndex(List=boundary_2, Indices=index_to_remove, Wrap=True)  # -> graft(List)
cull_i_2 = CullIndex(List=boundary, Indices=index_to_remove, Wrap=True)  # -> graft(List)
item_2 = ListItem(List=boundary_2, Index=index_to_remove, Wrap=True)
loft = Loft(
    Curves=[cull_i, cull_i_2],
    Options={Adjust=False, Closed=False, LoftEnds=0, LoftSimp=0, LoftType=0, Rebuild=10, Refit=0.01})  # -> flatten(Loft)
cap = CapHoles(Brep=loft)
