# Grasshopper definition mycolamp.gh (Grasshopper 1.0.7)

rectangle = Rectangle(Plane=PlaneXY(0, 0, 0), XSize=Domain(-45, 45), YSize=Domain(-15, 15), Radius=0)  # -> Rectangle, Length
esp32 = BoxRectangle(Rectangle=rectangle.Rectangle, Height=Domain(0, 20))
inner_case_wall = Slider(3, range=1..10)
shape_thickness = Slider(1, range=1..20)
height_of_inner_case = Slider(20, range=1..20)
subtraction = Subtraction(A=height_of_inner_case, B=inner_case_wall)
Z = UnitZ(Factor=subtraction)
Z_2 = UnitZ(Factor=height_of_inner_case)
Z_3 = UnitZ(Factor=Slider(5, range=0..10))

base_radius = Slider(19, range=10..300)
base_height = Slider(6, range=5..20)
p1_height = Slider(11, range=10..300)
p1_radius = Slider(20, range=10..250)
p2_height = Slider(12, range=10..300)
p2_radius = Slider(18, range=10..250)
p3_radius = Slider(16, range=10..250)
p3_height = Slider(29, range=0..300)
p4_radius = Slider(19, range=1..250)
p4_height = Slider(11, range=0..300)

addition = Addition(A=base_height, B=p1_height)
pt = ConstructPoint(XCoordinate=0, YCoordinate=0, ZCoordinate=addition)
circle = CircleCNR(Center=pt, Normal=Vector(0, 0, 1), Radius=p1_radius)

addition_2 = Addition(A=addition, B=p2_height)
pt_2 = ConstructPoint(XCoordinate=0, YCoordinate=0, ZCoordinate=addition_2)
circle_2 = CircleCNR(Center=pt_2, Normal=Vector(0, 0, 1), Radius=p2_radius)

addition_3 = Addition(A=addition_2, B=p3_height)
pt_3 = ConstructPoint(XCoordinate=0, YCoordinate=0, ZCoordinate=addition_3)
circle_3 = CircleCNR(Center=pt_3, Normal=Vector(0, 0, 1), Radius=p3_radius)

addition_4 = Addition(A=addition_3, B=p4_height)
pt_4 = ConstructPoint(XCoordinate=0, YCoordinate=0, ZCoordinate=addition_4)
circle_4 = CircleCNR(Center=pt_4, Normal=Vector(0, 0, 1), Radius=p4_radius)

pt_5 = ConstructPoint(XCoordinate=0, YCoordinate=0, ZCoordinate=0)
base = CircleCNR(Center=pt_5, Normal=Vector(0, 0, 1), Radius=base_radius)
Z_4 = UnitZ(Factor=base_height)
move = Move(Geometry=base, Motion=Z_4)  # -> Geometry, Transform
base_srf = Loft(
    Curves=[base, move.Geometry],
    Options={Adjust=False, Closed=False, LoftEnds=0, LoftSimp=0, LoftType=0, Rebuild=10, Refit=0.01})
base_top_circle = Geometry(move.Geometry)
base_surface = Geometry(base_srf)

addition_5 = Addition(A=shape_thickness, B=base_radius)
addition_6 = Addition(A=base_height, B=Slider(4, range=1..5))
Z_5 = UnitZ(Factor=addition_6)
circle_5 = CircleCNR(Center=pt_5, Normal=Vector(0, 0, 1), Radius=addition_5)
move_2 = Move(Geometry=circle_5, Motion=Z_5)  # -> Geometry, Transform
loft = Loft(
    Curves=[move_2.Geometry, circle_5],
    Options={Adjust=False, Closed=False, LoftEnds=0, LoftSimp=0, LoftType=0, Rebuild=10, Refit=0.01})

subtraction_2 = Subtraction(A=base_radius, B=inner_case_wall)
circle_6 = CircleCNR(Center=pt_5, Normal=Vector(0, 0, 1), Radius=subtraction_2)

lowest_point = Point(pt_5)
highest_point = Point(pt_4)
axis = Line(StartPoint=lowest_point, EndPoint=highest_point)

boundary = BoundarySurfaces(Edges=base)
boundary_2 = BoundarySurfaces(Edges=circle_6)
area = Area(Geometry=boundary)  # -> Area, Centroid
pt_6 = Point(pt_4)
geo = Geometry(circle_4)

merge = Merge(Data1=base_top_circle, Data2=circle, Data4=circle_3, Data5=circle_4)
loft_2 = Loft(Curves=merge, Options={Adjust=False, Closed=False, LoftEnds=0, LoftSimp=0, LoftType=0, Rebuild=10, Refit=0.01})

geo_2 = Geometry(base_top_circle)

pedestal_thickness = Slider(13, range=10..30)
neg = Negative(Value=pedestal_thickness)
offset = OffsetCurve(Curve=geo_2, Distance=Slider(8, range=5..20), Plane=PlaneXY(0, 0, 0), Corners=1)
Z_6 = UnitZ(Factor=neg)
move_3 = Move(Geometry=offset, Motion=Z_6)  # -> Geometry, Transform
loft_3 = Loft(
    Curves=[offset, move_3.Geometry],
    Options={Adjust=False, Closed=False, LoftEnds=0, LoftSimp=0, LoftType=0, Rebuild=10, Refit=0.01})
cap = CapHoles(Brep=loft_3)

circle_7 = CircleCNR(Center=area.Centroid, Normal=Vector(0, 0, 1), Radius=Slider(5, range=1..20))
boundary_3 = BoundarySurfaces(Edges=circle_7)
rdiff = RegionDifference(CurvesA=boundary, CurvesB=boundary_3)
extr = Extrude(Base=boundary_2, Direction=Z)
boundary_4 = BoundarySurfaces(Edges=rdiff)
cap_2 = CapHoles(Brep=loft_2)
area_2 = Area(Geometry=move_3.Geometry)  # -> Area, Centroid
debrep = DeconstructBrep(Brep=cap_2)  # -> Faces, Edges, Vertices
extr_2 = Extrude(Base=boundary_4, Direction=Z_2)
item = ListItem(List=debrep.Faces, Index=Slider(2, range=0..10), Wrap=True)
circle_8 = CircleCNR(Center=area_2.Centroid, Normal=Vector(0, 0, 1), Radius=Slider(5, range=0..20))
geo_3 = Geometry(item)
divide = DivideCurve(Curve=move_3.Geometry, Count=1, Kinks=False)  # -> Points, Tangents, Parameters
boundary_5 = BoundarySurfaces(Edges=circle_8)
Z_7 = UnitZ(Factor=pedestal_thickness)
extr_3 = Extrude(Base=boundary_5, Direction=Z_7)
sdiff = SolidDifference(BrepsA=extr_2, BrepsB=extr)
circle_9 = CircleCNR(Center=divide.Points, Normal=Vector(0, 0, 1), Radius=1)
sdiff_2 = SolidDifference(BrepsA=cap, BrepsB=extr_3)
surface_to_puncture = Geometry(geo_3)
divide_2 = DivideCurve(Curve=circle_9, Count=4, Kinks=False)  # -> Points, Tangents, Parameters
ln = Line(StartPoint=divide.Points, EndPoint=area_2.Centroid)
move_4 = Move(Geometry=divide.Points, Motion=Z_3)  # -> Geometry, Transform
item_2 = ListItem(List=divide_2.Points, Index=1, Wrap=True)
item_3 = ListItem(List=divide_2.Points, Index=3, Wrap=True)
arc = Arc3Pt(PointA=item_2, PointB=move_4.Geometry, PointC=item_3)  # -> Arc, Plane, Radius
ln_2 = Line(StartPoint=item_2, EndPoint=item_3)
join = JoinCurves(Curves=[arc.Arc, ln_2], Preserve=False)
geo_4 = Geometry(sdiff_2)
boundary_6 = BoundarySurfaces(Edges=join)
extrcrv = ExtrudeAlong(Base=boundary_6, Curve=ln)
geo_5 = Geometry(sdiff)

top_cap = Loft(
    Curves=[move_2.Geometry, move.Geometry],
    Options={Adjust=False, Closed=False, LoftEnds=0, LoftSimp=0, LoftType=0, Rebuild=10, Refit=0.01})
bottom_cap = Loft(
    Curves=[circle_5, base],
    Options={Adjust=False, Closed=False, LoftEnds=0, LoftSimp=0, LoftType=0, Rebuild=10, Refit=0.01})
top_center_pt = Point(pt_4)
top_face = Geometry(circle_4)
merge_2 = Merge(Data1=base_surface, Data2=loft, Data3=top_cap, Data4=bottom_cap)
loft_4 = Loft(
    Curves=[circle_5, move_2.Geometry],
    Options={Adjust=False, Closed=False, LoftEnds=0, LoftSimp=0, LoftType=0, Rebuild=10, Refit=0.01})
scale = Scale(Geometry=top_face, Center=top_center_pt, Factor=Slider(1.02, range=1..2))  # -> Geometry, Transform
Z_8 = UnitZ(Factor=Slider(2, range=1..20))
join_2 = BrepJoin(Breps=merge_2)  # -> Breps, Closed
move_5 = Move(Geometry=scale.Geometry, Motion=Z_8)  # -> Geometry, Transform
rad = Radians(Degrees=0)
rotax = RotateAxis(Geometry=move_5.Geometry, Angle=rad, Axis=axis)  # -> Geometry, Transform
cap_3 = CapHoles(Brep=loft_4)
base_2 = Geometry(join_2.Breps)
divide_3 = DivideCurve(Curve=top_face, Count=56, Kinks=False)  # -> Points, Tangents, Parameters
divide_4 = DivideCurve(Curve=rotax.Geometry, Count=28, Kinks=False)  # -> Points, Tangents, Parameters
dispatch = Dispatch(List=divide_3.Points, DispatchPattern=[True, False])  # -> ListA, ListB
geo_6 = Geometry(dispatch.ListA)
shape_thickness_2 = Number(shape_thickness)
neg_2 = Negative(Value=shape_thickness_2)

geo_7 = Geometry(dispatch.ListB)

arc_2 = Arc3Pt(PointA=geo_6, PointB=divide_4.Points, PointC=geo_7)  # -> Arc, Plane, Radius
ln_3 = Line(StartPoint=geo_6, EndPoint=geo_7)
join_3 = JoinCurves(Curves=[ln_3, arc_2.Arc], Preserve=False)
boundary_7 = BoundarySurfaces(Edges=join_3)  # -> graft(Surfaces)
offset_2 = OffsetSurface(Surface=boundary_7, Distance=neg_2, Retrim=True)  # -> graft(Surface)
long = LongestList(ListA=offset_2, ListB=boundary_7, PaddingMode=2)  # -> ListA, ListB
loft_5 = Loft(
    Curves=[long.ListA, long.ListB],
    Options={Adjust=False, Closed=False, LoftEnds=0, LoftSimp=0, LoftType=0, Rebuild=10, Refit=0.01})
cap_4 = CapHoles(Brep=loft_5)

sdiff_3 = SolidDifference(BrepsA=geo_4, BrepsB=cap_3)
sdiff_4 = SolidDifference(BrepsA=sdiff_3, BrepsB=extrcrv)
geo_8 = Geometry(sdiff_4)
base_solid = Geometry(base_2)
geo_9 = Geometry(cap_4)

cell_count = Slider(50, range=10..300)

cell_seed = Slider(20, range=1..100)
cell_radius = Slider(30, range=0..50)
cell_scale = Slider(0.5, range=0.1..1.1)
surface = Surface(surface_to_puncture)
thickness = Number(shape_thickness)
dimensions = Dimensions(Surface=surface)  # -> UDimension, VDimension
plane_surface = PlaneSurface(Plane=PlaneXY(0, 0, 0), XSize=dimensions.UDimension, YSize=dimensions.VDimension)
curve = Curve(plane_surface)
thickness_2 = Number(thickness)
unit_z = UnitZ(Factor=thickness_2)
number_slider = Slider(1, range=1..2)
surface_2 = Surface(surface)

populate_geometry = PopulateGeometry(Geometry=plane_surface, Count=cell_count, Seed=cell_seed)

voronoi = Voronoi(Points=populate_geometry, Boundary=curve, BruteForceOverride=False)
fillet = Fillet(Curve=voronoi, Radius=cell_radius)
area_3 = Area(Geometry=fillet)  # -> Area, Centroid
scale_2 = Scale(Geometry=fillet, Center=area_3.Centroid, Factor=cell_scale)  # -> Geometry, Transform
merge_3 = Merge(Data1=flatten(scale_2.Geometry), Data2=flatten(curve))  # -> flatten(Result)
boundary_surfaces = BoundarySurfaces(Edges=merge_3)
extrude = Extrude(Base=boundary_surfaces, Direction=unit_z)
box = Box(extrude)
surface_morph = SurfaceMorph(
    Geometry=extrude,
    Reference=box,
    Surface=reparameterize(surface_2),
    UDomain=number_slider,
    VDomain=number_slider,
    WDomain=thickness_2)

shape_surface = Geometry(surface_morph)
join_4 = BrepJoin(Breps=[base_solid, shape_surface])  # -> Breps, Closed
sunion = SolidUnion(Breps=join_4.Breps)
