# Grasshopper definition parametric-shape-mold.gh (Grasshopper 1.0.7)
# plug-ins: GhPolyhedra

crystal_shape = ValueList({"Dodecahedron": "Augmented Dodecahedron (J58)", "Geodesic Icosahedron": "Dual Geodesic Icosahedron Pattern 2", "Rhombicosidodecahedron": "Bigyrate Diminished Rhombicosidodecahedron (J79)", "Hexpropello Cube": "Biscribed Hexpropello Cube (dextro)"}, selected="Dodecahedron")
crystal_size = Slider(12, range=10..200)
rotation_xy = Slider(0, range=0..360)
rotation_xz = Slider(0, range=0..360)
# Dual Geodesic Icosahedron Pattern 2
panel = Panel("Augmented Dodecahedron (J58)")
# Bigyrate Diminished Rhombicosidodecahedron (J79)
# Biscribed Hexpropello Cube (dextro)
number_slider = Slider(12, range=10..200)
polyhedron = Polyhedron(Name=panel, Plane=PlaneXY(0, 0, 0), Scale=number_slider)  # -> Curves, Meshes, Solid
polyhedron_2 = Polyhedron(Name=crystal_shape, Plane=PlaneXY(0, 0, 0), Scale=crystal_size)  # -> Curves, Meshes, Solid
mesh_join = MeshJoin(Meshes=polyhedron_2.Meshes)
mesh_join_2 = MeshJoin(Meshes=polyhedron.Meshes)
face_boundaries = FaceBoundaries(Mesh=mesh_join)
xy_plane = XYPlane(Origin=Point(0, 0, 0))
area = Area(Geometry=mesh_join)  # -> Area, Centroid
boundary_surfaces = BoundarySurfaces(Edges=face_boundaries)  # -> graft(Surfaces)
radians = Radians(Degrees=rotation_xy)
plane_through_shape = PlaneThroughShape(Plane=xy_plane, Inflate=1, SectionLogic=False)
geometry = Geometry(mesh_join_2)
explode_tree = ExplodeTree(Data=boundary_surfaces)  # -> _0000, _0001
evaluate_surface = EvaluateSurface(Surface=boundary_surfaces, Point=area.Centroid)  # -> Point, Normal, UDirection, VDirection, Frame
face_boundaries_2 = FaceBoundaries(Mesh=geometry)
radians_2 = Radians(Degrees=rotation_xz)
xz_plane = XZPlane(Origin=Point(0, 0, 0))
bounding_box = BoundingBox(Content=geometry, Plane=PlaneXY(0, 0, 0))  # -> Box, Box_2
rotate = Rotate(Angle=radians, Plane=PlaneXY(0, 0, 0))  # -> Geometry, Transform
rotate_axis = RotateAxis(Angle=1.570796327, Axis=Line((0, 0, 0), (10, 0, 0)))  # -> Geometry, Transform
boundary_surfaces_2 = BoundarySurfaces(Edges=face_boundaries_2)
rotate_2 = Rotate(Geometry=rotate.Geometry, Angle=radians_2, Plane=xz_plane)  # -> Geometry, Transform
scale = Scale(Geometry=bounding_box.Box, Center=Point(0, 0, 0), Factor=Slider(1.8, range=1..2))  # -> Geometry, Transform
xy_plane_2 = XYPlane(Origin=Point(0, 0, 0))
brep_join = BrepJoin(Breps=boundary_surfaces_2)  # -> Breps, Closed
move_to_plane = MoveToPlane(Geometry=rotate_2.Geometry, Plane=PlaneXY(0, 0, 0), Above=True, Below=True)  # -> Geometry, Transform
deconstruct_brep = DeconstructBrep(Brep=brep_join.Breps)  # -> Faces, Edges, Vertices
brep_join_2 = BrepJoin(Breps=brep_join.Breps)  # -> flatten(Breps), Closed
plane_through_shape_2 = PlaneThroughShape(Plane=xy_plane_2, Shape=scale.Geometry, Inflate=1, SectionLogic=False)
area_2 = Area(Geometry=plane_through_shape_2)  # -> Area, Centroid
solid_union = SolidUnion(Breps=brep_join_2.Breps)  # -> flatten(Result)
split_brep = SplitBrep(Brep=scale.Geometry, Cutter=plane_through_shape_2)
split_brep_2 = SplitBrep(Brep=brep_join.Breps, Cutter=plane_through_shape_2)
cap_holes = CapHoles(Brep=split_brep_2)
cap_holes_2 = CapHoles(Brep=split_brep)
list_item = ListItem(List=deconstruct_brep.Edges, Index=Slider(16, range=0..34), Wrap=True)
deconstruct_brep_2 = DeconstructBrep(Brep=cap_holes)  # -> Faces, Edges, Vertices
scale_2 = Scale(Geometry=cap_holes_2, Center=Point(0, 0, 0), Factor=Slider(0.8, range=0.1..1))  # -> Geometry, Transform
area_3 = Area(Geometry=deconstruct_brep_2.Faces)  # -> Area, Centroid
point_on_curve = PointOnCurve(list_item, parameter=0.513)
curve = Curve(list_item)
solid_difference = SolidDifference(BrepsA=cap_holes_2, BrepsB=scale_2.Geometry)  # -> graft(Result)
bounds = Bounds(Numbers=area_3.Area)
deconstruct_brep_3 = DeconstructBrep(Brep=scale_2.Geometry)  # -> Faces, Edges, Vertices
point = Point(point_on_curve)
deconstruct_domain = DeconstructDomain(Domain=bounds)  # -> Start, End
deconstruct_brep_4 = DeconstructBrep(Brep=solid_difference)  # -> Faces, Edges, Vertices
explode_tree_2 = ExplodeTree(Data=deconstruct_brep_2.Faces)
equality = Equality(FirstNumber=area_3.Area, SecondNumber=deconstruct_domain.End)  # -> Equality, Inequality
dispatch = Dispatch(List=deconstruct_brep_2.Faces, DispatchPattern=equality.Equality)  # -> ListA, ListB
area_4 = Area(Geometry=deconstruct_brep_4.Faces)  # -> Area, Centroid
list_item_2 = ListItem(List=deconstruct_brep_4.Faces, Index=0, Wrap=True)
list_item_3 = ListItem(List=deconstruct_brep_3.Edges, Index=Slider(2, range=0..23), Wrap=True)
point_2 = Point(area_2.Centroid)
reverse_list = ReverseList(List=cap_holes)
explode_tree_3 = ExplodeTree(Data=list_item_3)  # -> _00000, _00001
unit_x = UnitX(Factor=Slider(3, range=0..10))
geometry_2 = Geometry(dispatch.ListA)
explode_tree_4 = ExplodeTree(Data=area_4.Centroid)  # -> _000000, _000010
point_list = PointList(Points=area_4.Centroid, Size=Slider(8, range=0..100))
area_5 = Area(Geometry=geometry_2)  # -> Area, Centroid
unit_x_2 = UnitX(Factor=Slider(-6, range=-20..20))
curve_2 = Curve(explode_tree_3._00000)
curve_closest_point = CurveClosestPoint(Point=point, Curve=curve_2)  # -> Point, Parameter, Distance
point_on_curve_2 = PointOnCurve(curve_2, parameter=0.278)
point_on_curve_3 = PointOnCurve(curve_2, parameter=0.705)
move = Move(Geometry=curve_closest_point.Point, Motion=unit_x)  # -> Geometry, Transform
list_item_4 = ListItem(List=explode_tree_4._000000, Index=Slider(10, range=0..10), Wrap=True)
list_item_5 = ListItem(List=explode_tree_4._000010, Index=Slider(6, range=0..10), Wrap=True)
point_3 = Point(curve_closest_point.Point)
circle_cnr = CircleCNR(Center=point_on_curve_2, Normal=Vector(0, 0, 1), Radius=Slider(1.5, range=0.5..3))
move_2 = Move(Geometry=point_2, Motion=unit_x_2)  # -> Geometry, Transform
circle_cnr_2 = CircleCNR(Center=point, Normal=Vector(0, 0, 1), Radius=Slider(3, range=1..10))
merge = Merge(Data1=list_item_4, Data2=list_item_5)
vector_2pt = Vector2Pt(PointA=area_5.Centroid, PointB=merge, Unitize=False)  # -> Vector, Length
move_3 = Move(Geometry=graft(reverse_list), Motion=vector_2pt.Vector)  # -> Geometry, Transform
circle_cnr_3 = CircleCNR(Center=move.Geometry, Normal=Vector(0, 0, 1), Radius=Slider(4, range=1..15))
explode_tree_5 = ExplodeTree(Data=move_3.Geometry)  # -> _000000, _000010
explode_tree_6 = ExplodeTree(Data=solid_difference)  # -> _00000, _00001
boundary_surfaces_3 = BoundarySurfaces(Edges=circle_cnr)
circle_cnr_4 = CircleCNR(Center=move_2.Geometry, Normal=Vector(0, 0, 1), Radius=Slider(2, range=1..4))
boundary_surfaces_4 = BoundarySurfaces(Edges=circle_cnr_4)
boundary_surfaces_5 = BoundarySurfaces(Edges=circle_cnr_3)
boundary_surfaces_6 = BoundarySurfaces(Edges=circle_cnr_2)
rotate_3d = Rotate3D(Geometry=boundary_surfaces_6, Angle=1.570796327, Center=point, Axis=curve)  # -> flatten(Geometry), Transform
unit_y = UnitY(Factor=Slider(-0.8, range=-5..0))
rotate_3d_2 = Rotate3D(Geometry=boundary_surfaces_5, Angle=1.570796327, Center=move.Geometry, Axis=curve_2)  # -> flatten(Geometry), Transform
unit_y_2 = UnitY(Factor=Slider(1.3, range=0..5))
rotate_3d_3 = Rotate3D(Geometry=boundary_surfaces_4, Angle=1.570796327, Center=circle_cnr_4, Axis=curve_2)  # -> flatten(Geometry), Transform
rotate_3d_4 = Rotate3D(Geometry=boundary_surfaces_3, Angle=1.570796327, Center=point_on_curve_2, Axis=curve)  # -> flatten(Geometry), Transform
move_4 = Move(Geometry=rotate_3d_2.Geometry, Motion=unit_y_2)  # -> Geometry, Transform
move_5 = Move(Geometry=rotate_3d.Geometry, Motion=unit_y)  # -> Geometry, Transform
unit_y_3 = UnitY(Factor=Slider(0, range=0..5))
unit_y_4 = UnitY(Factor=Slider(3.1, range=-15..20))
loft = Loft(
    Curves=[move_5.Geometry, move_4.Geometry],
    Options={Adjust=False, Closed=False, LoftEnds=0, LoftSimp=0, LoftType=0, Rebuild=10, Refit=0.01})
move_6 = Move(Geometry=rotate_3d_3.Geometry, Motion=unit_y_3)  # -> Geometry, Transform
cap_holes_ex = CapHolesEx(Brep=loft)  # -> Brep, Caps, Solid
move_7 = Move(Geometry=rotate_3d_4.Geometry, Motion=unit_y_4)  # -> Geometry, Transform
brep = Brep(cap_holes_ex.Brep)
split_brep_3 = SplitBrep(Brep=brep, Cutter=plane_through_shape_2)
cap_holes_ex_2 = CapHolesEx(Brep=split_brep_3)  # -> flatten(Brep), Caps, Solid
loft_2 = Loft(
    Curves=[move_6.Geometry, move_7.Geometry],
    Options={Adjust=False, Closed=False, LoftEnds=0, LoftSimp=0, LoftType=0, Rebuild=10, Refit=0.01})
cap_holes_ex_3 = CapHolesEx(Brep=loft_2)  # -> Brep, Caps, Solid
brep_2 = Brep(cap_holes_ex_3.Brep)
split_brep_4 = SplitBrep(Brep=brep_2, Cutter=plane_through_shape_2)
cap_holes_ex_4 = CapHolesEx(Brep=split_brep_4)  # -> flatten(Brep), Caps, Solid
reverse_list_2 = ReverseList(List=cap_holes_ex_4.Brep)
move_8 = Move(Geometry=graft(reverse_list_2), Motion=vector_2pt.Vector)  # -> Geometry, Transform
explode_tree_7 = ExplodeTree(Data=move_8.Geometry)  # -> _000000, _000010
deconstruct_brep_5 = DeconstructBrep(Brep=solid_difference)  # -> flatten(Faces), Edges, Vertices
reverse_list_3 = ReverseList(List=cap_holes_ex_2.Brep)
move_9 = Move(Geometry=graft(reverse_list_3), Motion=vector_2pt.Vector)  # -> Geometry, Transform
explode_tree_8 = ExplodeTree(Data=move_9.Geometry)  # -> _000000, _000010
list_item_6 = ListItem(List=deconstruct_brep_5.Faces, Index=Slider(10, range=0..21), Wrap=True)  # -> flatten(Item)
list_item_7 = ListItem(List=deconstruct_brep_5.Faces, Index=Slider(17, range=0..21), Wrap=True)
number_slider_2 = Slider(0.8, range=0.1..1)
area_6 = Area(Geometry=list_item_7)  # -> Area, Centroid
area_7 = Area(Geometry=list_item_6)  # -> Area, Centroid
scale_3 = Scale(Geometry=list_item_6, Center=area_7.Centroid, Factor=number_slider_2)  # -> Geometry, Transform
scale_4 = Scale(Geometry=list_item_7, Center=area_6.Centroid, Factor=number_slider_2)  # -> Geometry, Transform
number_slider_3 = Slider(2, range=0.1..2)
control_points = ControlPoints(Curve=scale_3.Geometry)  # -> Points, Weights, Knots
control_points_2 = ControlPoints(Curve=scale_4.Geometry)  # -> Points, Weights, Knots
circle_cnr_5 = CircleCNR(Center=control_points.Points, Normal=Vector(0, 0, 1), Radius=number_slider_3)
circle_cnr_6 = CircleCNR(Center=control_points_2.Points, Normal=Vector(0, 0, 1), Radius=number_slider_3)
unit_z = UnitZ(Factor=Slider(3, range=1..10))
sphere = Sphere(Base=circle_cnr_5, Radius=number_slider_3)  # -> graft(Sphere)
sphere_2 = Sphere(Base=circle_cnr_6, Radius=number_slider_3)  # -> graft(Sphere)
extrude = Extrude(Base=circle_cnr_5, Direction=unit_z)  # -> graft(Extrusion)
extrude_2 = Extrude(Base=circle_cnr_6, Direction=unit_z)  # -> graft(Extrusion)
explode_tree_9 = ExplodeTree(Data=sphere)  # -> Branch0, Branch1, Branch2, Branch3, Branch4
explode_tree_10 = ExplodeTree(Data=sphere_2)  # -> Branch0, Branch1, Branch2, Branch3, Branch4
brep_join_3 = BrepJoin(Breps=[explode_tree_9.Branch0, explode_tree_9.Branch1, explode_tree_9.Branch2, explode_tree_9.Branch3])  # -> flatten(Breps), Closed
brep_join_4 = BrepJoin(Breps=[explode_tree_10.Branch0, explode_tree_10.Branch1, explode_tree_10.Branch2, explode_tree_10.Branch3])  # -> flatten(Breps), Closed
cap_holes_ex_5 = CapHolesEx(Brep=brep_join_3.Breps)  # -> Brep, Caps, Solid
solid_union_2 = SolidUnion(Breps=flatten([explode_tree_5._000000, explode_tree_6._00000, explode_tree_8._000000, explode_tree_7._000000]))
solid_union_3 = SolidUnion(Breps=flatten([explode_tree_5._000010, explode_tree_6._00001, explode_tree_8._000010, explode_tree_7._000010]))
cap_holes_ex_6 = CapHolesEx(Brep=brep_join_4.Breps)  # -> Brep, Caps, Solid
solid_difference_2 = SolidDifference(BrepsA=solid_union_2, BrepsB=cap_holes_ex_5.Brep)
solid_union_4 = SolidUnion(Breps=[solid_union_3, cap_holes_ex_6.Brep])
merge_2 = Merge(Data1=solid_difference_2, Data2=solid_union_4)
