# Grasshopper definition parametric-voronoi-stool.gh (Grasshopper 1.0.7)

legs_curve_offset = ValueList({"0", "10mm": 10, "20mm": 20, "30mm": 30, "40mm": 40, "50mm": 50}, selected="30mm")
legs_sides_fillet = ValueList({"5mm": 5, "15mm": 15, "20mm": 20, "50mm": 50, "100mm": 100, "150mm": 150, "200mm": 200, "250mm": 250, "300m": 300}, selected="150mm")
legs_curve_fillet = ValueList({"5mm": 5, "15mm": 15, "20mm": 20, "50mm": 50, "100mm": 100, "150mm": 150, "200mm": 200, "250mm": 250, "300m": 300}, selected="20mm")
bottom_offset = ValueList({"10mm": -10, "20mm": -20, "30mm": -30, "40mm": -40, "50mm": -50, "60mm": -60, "70mm": -70, "80mm": -80, "90mm": -90}, selected="80mm")
material_thickness = ValueList({"4mm": 4, "4.5mm": 4.5, "5mm": 5, "7mm": 7, "15mm": 15, "15.2mm": 15.2, "16mm": 16, "20mm": 20}, selected="15.2mm")
drill_diameter = ValueList({"6mm": 6}, selected="6mm")
base = ValueList({"10cm": 100, "15cm": 150, "20cm": 200, "25cm": 250, "30cm": 300, "35cm": 350, "40cm": 400, "45cm": 450, "50cm": 500}, selected="30cm")
edge = ValueList({"0.5cm": -5, "1cm": -10, "1.5cm": -15, "2cm": -20, "2.5cm": -25, "3cm": -30, "3.5cm": -35, "4cm": -40, "4.5cm": -45, "5cm": -50}, selected="2cm")
inner = ValueList({"2.5cm": 25, "4cm": 40, "5cm": 50, "7.5cm": 75, "10cm": 100, "12.5cm": 125, "15cm": 150, "17.5cm": 175, "20cm": 200}, selected="15cm")
pattern_radius = ValueList({"5mm": 5, "10mm": 10, "15mm": 15, "20mm": 20, "25mm": 25, "30mm": 30, "35mm": 35, "40mm": 40}, selected="25mm")
pattern_gap = ValueList({"5mm": -5, "10mm": -10, "15mm": -15, "20mm": -20, "25mm": -25, "30mm": -30}, selected="5mm")
height = ValueList({"15cm": -150, "25cm": -250, "30cm": -300, "40cm": -400, "45cm": -450, "50cm": -500, "60cm": -600, "70cm": -700, "80cm": -800}, selected="45cm")
pattern_seed = ControlKnob(Decimals=0, Limit=False, Maximum=10, Minimum=0, Range=100, Value=163)
pattern_granularity = Slider(100, range=10..150)
joint_edge = ValueList({"5mm": 5, "10mm": 10, "15mm": 15, "20mm": 20, "25mm": 25, "30mm": 30, "35mm": 35, "40mm": 40}, selected="25mm")
base_center = ConstructPoint(XCoordinate=0, YCoordinate=0, ZCoordinate=0)
inner_2 = CircleCNR(Center=base_center, Normal=Vector(0, 0, 1), Radius=inner)
base_2 = CircleCNR(Center=base_center, Normal=Vector(0, 0, 1), Radius=base)
edge_offset = OffsetCurve(Curve=base_2, Distance=edge, Plane=PlaneXY(0, 0, 0), Corners=1)
boundary_surfaces = BoundarySurfaces(Edges=edge_offset)
boundary_surfaces_2 = BoundarySurfaces(Edges=inner_2)
solid_difference = SolidDifference(BrepsA=boundary_surfaces, BrepsB=boundary_surfaces_2)
bounding_box = BoundingBox(Content=solid_difference, Plane=PlaneXY(0, 0, 0))  # -> Box, Box_2
populate_geometry = PopulateGeometry(Geometry=solid_difference, Count=pattern_granularity, Seed=pattern_seed)
voronoi = Voronoi(Points=populate_geometry, Boundary=bounding_box.Box, BruteForceOverride=False)
value_list = ValueList({"5mm": -5, "10mm": -10, "15mm": -15, "20mm": -20}, selected="10mm")
fillet = Fillet(Curve=voronoi, Radius=pattern_radius)
inner_3 = Curve(inner_2)
region_intersection = RegionIntersection(CurvesA=fillet, CurvesB=edge_offset)
offset_curve = OffsetCurve(Curve=inner_3, Distance=value_list, Plane=PlaneXY(0, 0, 0), Corners=1)
division = Division(A=material_thickness, B=2)
region_difference = RegionDifference(CurvesA=region_intersection, CurvesB=inner_2)
divide_curve = DivideCurve(Curve=offset_curve, Count=4, Kinks=False)  # -> Points, Tangents, Parameters
_0 = ListItem(List=divide_curve.Points, Index=0, Wrap=True)
_1 = ListItem(List=divide_curve.Points, Index=1, Wrap=True)
_2 = ListItem(List=divide_curve.Points, Index=2, Wrap=True)
_3 = ListItem(List=divide_curve.Points, Index=3, Wrap=True)
negative = Negative(Value=division)
line = Line(StartPoint=_0, EndPoint=_2)
line_2 = Line(StartPoint=_1, EndPoint=_3)
offset_curve_2 = OffsetCurve(Curve=region_difference, Distance=pattern_gap, Plane=PlaneXY(0, 0, 0), Corners=1)
offset_curve_3 = OffsetCurve(Curve=line, Distance=division, Plane=PlaneXY(0, 0, 0), Corners=1)
offset_curve_4 = OffsetCurve(Curve=line_2, Distance=division, Plane=PlaneXY(0, 0, 0), Corners=1)
offset_curve_5 = OffsetCurve(Curve=line_2, Distance=negative, Plane=PlaneXY(0, 0, 0), Corners=1)
region_intersection_2 = RegionIntersection(CurvesA=offset_curve_2, CurvesB=edge_offset)
offset_curve_6 = OffsetCurve(Curve=line, Distance=negative, Plane=PlaneXY(0, 0, 0), Corners=1)
unit_z = UnitZ(Factor=material_thickness)
curve = Curve(base_2)
curve_2 = Curve(region_intersection_2)
edge_surface = EdgeSurface(CurveA=offset_curve_4, CurveB=offset_curve_5)
edge_surface_2 = EdgeSurface(CurveA=offset_curve_3, CurveB=offset_curve_6)
base_3 = Curve(base_2)
region_union = RegionUnion(Curves=[edge_surface_2, edge_surface])
unit_z_2 = UnitZ(Factor=material_thickness)
division_2 = Division(A=drill_diameter, B=2)
divide_curve_2 = DivideCurve(Curve=base_3, Count=4, Kinks=False)  # -> Points, Tangents, Parameters
fillet_2 = Fillet(Curve=region_union, Radius=division_2)
list_item = ListItem(List=divide_curve_2.Points, Index=0, Wrap=True)
list_item_2 = ListItem(List=divide_curve_2.Points, Index=2, Wrap=True)
negative_2 = Negative(Value=material_thickness)
line_3 = Line(StartPoint=list_item, EndPoint=list_item_2)
curve_3 = Curve(offset_curve_6)
unit_z_3 = UnitZ(Factor=negative_2)
unit_z_4 = UnitZ(Factor=height)
merge = Merge(Data1=curve, Data2=curve_2, Data3=fillet_2)  # -> flatten(Result)
offset_curve_7 = OffsetCurve(Curve=line_3, Distance=negative, Plane=PlaneXY(0, 0, 0), Corners=1)
move = Move(Geometry=curve_3, Motion=unit_z_3)  # -> Geometry, Transform
edge_surface_3 = EdgeSurface(CurveA=move.Geometry, CurveB=curve_3)
extend_curve = ExtendCurve(Curve=offset_curve_7, Type=0, Start=bottom_offset, End=bottom_offset)
end_points = EndPoints(Curve=curve_3)  # -> Start, End
end_points_2 = EndPoints(Curve=move.Geometry)  # -> Start, End
curve_4 = Curve(move.Geometry)
extend_curve_2 = ExtendCurve(Curve=curve_4, Type=0, Start=joint_edge, End=joint_edge)
line_4 = Line(StartPoint=end_points_2.Start, EndPoint=end_points.Start)
line_5 = Line(StartPoint=end_points_2.End, EndPoint=end_points.End)
curve_5 = Curve(extend_curve)
boundary_surfaces_3 = BoundarySurfaces(Edges=merge)
end_points_3 = EndPoints(Curve=extend_curve_2)  # -> Start, End
line_6 = Line(StartPoint=end_points_2.Start, EndPoint=end_points_3.Start)
line_7 = Line(StartPoint=end_points_2.End, EndPoint=end_points_3.End)
move_2 = Move(Geometry=curve_5, Motion=unit_z_4)  # -> Geometry, Transform
end_points_4 = EndPoints(Curve=move_2.Geometry)  # -> Start, End
line_8 = Line(StartPoint=end_points_3.End, EndPoint=end_points_4.End)
line_9 = Line(StartPoint=end_points_3.Start, EndPoint=end_points_4.Start)
merge_2 = Merge(Data1=curve_3, Data2=line_4, Data3=line_5, Data4=line_8, Data5=line_9, Data6=move_2.Geometry, Data7=line_7, Data8=line_6)
join_curves = JoinCurves(Curves=merge_2, Preserve=False)
boundary_surfaces_4 = BoundarySurfaces(Edges=join_curves)
curve_6 = Curve(move_2.Geometry)
line_10 = Line(curve_3)
polygon_center = PolygonCenter(Polyline=line_8)  # -> CenterV, CenterE, CenterA
polygon_center_2 = PolygonCenter(Polyline=line_9)  # -> CenterV, CenterE, CenterA
polygon_center_3 = PolygonCenter(Polyline=line_10)  # -> CenterV, CenterE, CenterA
polygon_center_4 = PolygonCenter(Polyline=curve_6)  # -> CenterV, CenterE, CenterA
polygon_center_5 = PolygonCenter(Polyline=boundary_surfaces_4)  # -> CenterV, CenterE, CenterA
extrude = Extrude(Base=boundary_surfaces_3, Direction=unit_z)
unit_x = UnitX(Factor=division)
unit_x_2 = UnitX(Factor=negative)
line_11 = Line(StartPoint=polygon_center_3.CenterV, EndPoint=polygon_center_4.CenterV)
polygon_center_6 = PolygonCenter(Polyline=line_11)  # -> CenterV, CenterE, CenterA
move_3 = Move(Geometry=polygon_center_6.CenterV, Motion=unit_x_2)  # -> Geometry, Transform
move_4 = Move(Geometry=polygon_center_6.CenterV, Motion=unit_x)  # -> Geometry, Transform
division_3 = Division(A=height, B=2)
line_12 = Line(StartPoint=move_4.Geometry, EndPoint=polygon_center_2.CenterV)
line_13 = Line(StartPoint=move_3.Geometry, EndPoint=polygon_center.CenterV)
line_14 = Line(StartPoint=move_4.Geometry, EndPoint=move_3.Geometry)
unit_x_3 = UnitX(Factor=legs_curve_offset)
unit_z_5 = UnitZ(Factor=division_3)
negative_3 = Negative(Value=material_thickness)
negative_4 = Negative(Value=unit_x_3)
move_5 = Move(Geometry=line_14, Motion=unit_z_5)  # -> Geometry, Transform
polygon_center_7 = PolygonCenter(Polyline=line_13)  # -> CenterV, CenterE, CenterA
polygon_center_8 = PolygonCenter(Polyline=line_12)  # -> CenterV, CenterE, CenterA
unit_z_6 = UnitZ(Factor=negative_3)
end_points_5 = EndPoints(Curve=move_5.Geometry)  # -> Start, End
end_points_6 = EndPoints(Curve=line_14)  # -> Start, End
move_6 = Move(Geometry=polygon_center_8.CenterV, Motion=negative_4)  # -> Geometry, Transform
top = Point(end_points_3.End)
top_2 = Point(end_points_3.Start)
bottom = Point(end_points_4.End)
move_7 = Move(Geometry=polygon_center_7.CenterV, Motion=unit_x_3)  # -> Geometry, Transform
bottom_2 = Point(end_points_4.Start)
merge_3 = Merge()
absolute = Absolute(Value=division_3)
line_15 = Line(StartPoint=move_6.Geometry, EndPoint=top_2)
line_16 = Line(StartPoint=bottom_2, EndPoint=move_6.Geometry)
line_17 = Line(StartPoint=bottom, EndPoint=move_7.Geometry)
line_18 = Line(StartPoint=top, EndPoint=move_7.Geometry)
line_19 = Line(StartPoint=end_points_5.Start, EndPoint=end_points_6.Start)
line_20 = Line(StartPoint=end_points_5.End, EndPoint=end_points_6.End)
number = Number(legs_sides_fillet)
join_curves_2 = JoinCurves(Curves=[line_15, line_16], Preserve=False)
join_curves_3 = JoinCurves(Curves=[line_18, line_17], Preserve=False)
unit_z_7 = UnitZ(Factor=absolute)
join_curves_4 = JoinCurves(Curves=[line_19, line_20, move_5.Geometry, line_14], Preserve=False)
fillet_3 = Fillet(Curve=join_curves_2, Radius=number)
fillet_4 = Fillet(Curve=join_curves_3, Radius=number)
merge_4 = Merge(
    Data1=curve_3,
    Data2=line_4,
    Data3=line_5,
    Data4=line_7,
    Data5=line_6,
    Data6=move_2.Geometry,
    Data7=fillet_4,
    Data8=fillet_3)
move_8 = Move(Geometry=join_curves_4, Motion=unit_z_7)  # -> Geometry, Transform
merge_5 = Merge(Data1=move_2.Geometry, Data2=fillet_4, Data3=fillet_3, Data4=extend_curve_2)
flatten_tree = FlattenTree(Tree=merge_4, Path="{0}")
move_9 = Move(Geometry=extrude, Motion=unit_z_6)  # -> Geometry, Transform
top_cut = BoundarySurfaces(Edges=move_8.Geometry)
bottom_cut = BoundarySurfaces(Edges=join_curves_4)
join_curves_5 = JoinCurves(Curves=merge_5, Preserve=False)  # -> simplify(flatten(Curves))
join_curves_6 = JoinCurves(Curves=flatten_tree, Preserve=False)
surface = Surface(edge_surface_3)
value_list_2 = ValueList({"2mm": 2, "5mm": 5, "8mm": 8, "10mm": 10, "15mm": 15, "20mm": 20, "25mm": 25, "30mm": 30, "35mm": 35, "40mm": 40}, selected="5mm")
boundary_surfaces_5 = BoundarySurfaces(Edges=join_curves_5)
boundary_surfaces_6 = BoundarySurfaces(Edges=join_curves_6)
fillet_5 = Fillet(Curve=boundary_surfaces_5, Radius=value_list_2)
boundary_surfaces_7 = BoundarySurfaces(Edges=fillet_5)
merge_6 = Merge(Data1=surface, Data2=boundary_surfaces_7)
merge_faces = MergeFaces(Brep=merge_6)  # -> Breps, Before, After
curve_7 = Curve(boundary_surfaces_6)
height_2 = ValueList({"1250mm": 1250, "625mm": 625}, selected="625mm")
width = ValueList({"2500mm": 2500, "1250mm": 1250}, selected="1250mm")
explode = Explode(Curve=curve_7, Recursive=True)  # -> Segments, Vertices
rectangle = Rectangle(Plane=PlaneXY(0, 0, 0), XSize=width, YSize=height_2, Radius=0)  # -> Rectangle, Length
list_item_3 = ListItem(List=explode.Segments, Index=1, Wrap=True)
list_item_4 = ListItem(List=explode.Segments, Index=2, Wrap=True)
list_item_5 = ListItem(List=explode.Segments, Index=3, Wrap=True)
curve_8 = Curve(merge)
merge_7 = Merge(Data1=list_item_4, Data2=list_item_3, Data3=list_item_5)
join_curves_7 = JoinCurves(Curves=merge_7, Preserve=False)
list_item_6 = ListItem(List=curve_8, Index=0, Wrap=True)
fillet_6 = Fillet(Curve=curve_7, Parameter=join_curves_7, Radius=legs_curve_fillet)  # -> Curve, Parameter
region_intersection_3 = RegionIntersection(CurvesA=curve_7, CurvesB=fillet_6.Curve)
list_item_7 = ListItem(List=explode.Segments, Index=1, Wrap=True)
list_item_8 = ListItem(List=explode.Segments, Index=3, Wrap=True)
merge_8 = Merge(Data2=list_item_7, Data3=list_item_8)
top_leg = Curve(curve_8)
param_viewer = ParamViewer(top_leg)
join_curves_8 = JoinCurves(Curves=merge_8, Preserve=False)
fillet_7 = Fillet(Curve=curve_7, Parameter=join_curves_8, Radius=legs_curve_fillet)  # -> Curve, Parameter
region_intersection_4 = RegionIntersection(CurvesA=region_intersection_3, CurvesB=fillet_7.Curve)
region_difference_2 = RegionDifference(CurvesA=region_intersection_4, CurvesB=bottom_cut)
region_difference_3 = RegionDifference(CurvesA=region_intersection_4, CurvesB=top_cut)
boundary_surfaces_8 = BoundarySurfaces(Edges=region_difference_3)
curve_9 = Curve(region_difference_2)
boundary_surfaces_9 = BoundarySurfaces(Edges=region_difference_2)
bottom_leg = Curve(curve_9)
curve_10 = Curve(region_difference_3)
top_leg_2 = Curve(curve_10)
top_leg_3 = Curve(simplify(flatten(top_leg_2)))
param_viewer_2 = ParamViewer(top_leg_3)
bottom_leg_2 = Curve(flatten(bottom_leg))
param_viewer_3 = ParamViewer(bottom_leg_2)
entwine = Entwine(Branch00=top_leg, Branch01=top_leg_3, Branch02=bottom_leg_2, FlattenInputs=True)  # -> simplify(Result)
md_slider = MDSlider(SliderMode=0, slider_value=Point(0.5, 0.5, 0.5), x_domain=Domain(0, 1), y_domain=Domain(0, 1), z_domain=Domain(0, 1))
param_viewer_4 = ParamViewer(entwine)
list_item_9 = ListItem(List=entwine, Index=0, Wrap=True)
unit_y = UnitY(Factor=material_thickness)
panel = Panel(entwine)
evaluate_surface = EvaluateSurface(Surface=reparameterize(list_item_9), Point=md_slider)  # -> Point, Normal, UDirection, VDirection, Frame
rotate = Rotate(Geometry=boundary_surfaces_8, Angle=1.570796327, Plane=PlaneXY(0, 0, 0))  # -> Geometry, Transform
negative_5 = Negative(Value=material_thickness)
unit_x_4 = UnitX(Factor=negative_5)
construct_plane = ConstructPlane(Origin=evaluate_surface.Point, XAxis=evaluate_surface.UDirection, YAxis=evaluate_surface.VDirection)
panel_2 = Panel(construct_plane)
extrude_2 = Extrude(Base=boundary_surfaces_9, Direction=unit_y)
extrude_3 = Extrude(Base=rotate.Geometry, Direction=unit_x_4)
stool = Merge(Data1=extrude_2, Data2=extrude_3, Data3=move_9.Geometry)
rectangle_2 = Rectangle(Plane=PlaneXY(0, 0, 0), XSize=Slider(811, range=0..1000), YSize=Slider(515, range=0..1000), Radius=0)  # -> Rectangle, Length

merge_9 = Merge(Data1=list_item_6, Data2=top_leg_2, Data3=bottom_leg)
bounding_box_2 = BoundingBox(Content=merge_9, Plane=PlaneXY(0, 0, 0))  # -> flatten(Box), Box_2
deconstruct_box = DeconstructBox(Box=bounding_box_2.Box)  # -> Plane, X, Y, Z
bounds = Bounds(Numbers=deconstruct_box.X)
bounds_2 = Bounds(Numbers=deconstruct_box.Y)
deconstruct_domain = DeconstructDomain(Domain=bounds)  # -> Start, End
deconstruct_domain_2 = DeconstructDomain(Domain=bounds_2)  # -> Start, End
list_length = ListLength(List=bounding_box_2.Box)

addition = Addition(A=Slider(74, range=0..100), B=deconstruct_domain.End)

square = Square(Plane=PlaneXY(0, 0, 0), Size=addition, ExtentX=list_length, ExtentY="1")  # -> Cells, Points
panel_3 = Panel(square.Cells)
area = Area(Geometry=square.Cells)  # -> Area, simplify(Centroid)

orient = Orient(Geometry=entwine, Source=construct_plane, Target=area.Centroid)  # -> Geometry, Transform
join_curves_9 = JoinCurves(Curves=orient.Geometry, Preserve=False)
boundary_surfaces_10 = BoundarySurfaces(Edges=orient.Geometry)
panel_4 = Panel(area.Centroid)
param_viewer_5 = ParamViewer(area.Centroid)
