# Grasshopper definition parametric-voronoi-tower.gh (Grasshopper 1.0.7)

base_radius = Slider(30, range=10..200)
bottom_height = Slider(12, range=1..100)
bottom_radius = Slider(19, range=10..200)
mid_radius = Slider(24, range=10..200)
top_height = Slider(78, range=1..100)
mid_height = Slider(47, range=1..100)
top_radius = Slider(24, range=10..200)
construct_point = ConstructPoint(XCoordinate=0, YCoordinate=0, ZCoordinate=0)
construct_point_2 = ConstructPoint(XCoordinate=0, YCoordinate=0, ZCoordinate=bottom_height)
construct_point_3 = ConstructPoint(XCoordinate=0, YCoordinate=0, ZCoordinate=mid_height)
construct_point_4 = ConstructPoint(XCoordinate=0, YCoordinate=0, ZCoordinate=top_height)
point = Point(construct_point)
circle_cnr = CircleCNR(Center=point, Normal=Vector(0, 0, 1), Radius=base_radius)
circle_cnr_2 = CircleCNR(Center=construct_point_2, Normal=Vector(0, 0, 1), Radius=bottom_radius)
circle_cnr_3 = CircleCNR(Center=construct_point_3, Normal=Vector(0, 0, 1), Radius=mid_radius)
circle_cnr_4 = CircleCNR(Center=construct_point_4, Normal=Vector(0, 0, 1), Radius=top_radius)
merge = Merge(Data1=circle_cnr, Data2=circle_cnr_2, Data3=circle_cnr_3, Data4=circle_cnr_4)
divide_curve = DivideCurve(Curve=merge, Count=1, Kinks=False)  # -> flatten(Points), Tangents, Parameters
boundary_surfaces = BoundarySurfaces(Edges=circle_cnr)
boundary_surfaces_2 = BoundarySurfaces(Edges=circle_cnr_4)
polyline = PolyLine(Vertices=divide_curve.Points, Closed=False)
area = Area(Geometry=boundary_surfaces_2)  # -> Area, Centroid
area_2 = Area(Geometry=boundary_surfaces)  # -> Area, Centroid
line = Line(StartPoint=area_2.Centroid, EndPoint=area.Centroid)
fillet = Fillet(Curve=polyline, Radius=Slider(200, range=0..200))
revolution = Revolution(Curve=fillet, Axis=line, Domain=Domain(0, 6.283185307))

base_radius_2 = Slider(19, range=10..200)
base_offset = Slider(-18, range=-20..20)
base_rotate_mid = Slider(92, range=0..360)
construct_point_5 = ConstructPoint(XCoordinate=0, YCoordinate=0, ZCoordinate=0)
unit_x = UnitX(Factor=base_offset)
point_2 = Point(construct_point_5)
circle_cnr_5 = CircleCNR(Center=point_2, Normal=Vector(0, 0, 1), Radius=base_radius_2)
move = Move(Geometry=circle_cnr_5, Motion=unit_x)  # -> Geometry, Transform
radians = Radians(Degrees=base_rotate_mid)
rotate = Rotate(Geometry=move.Geometry, Angle=radians, Plane=PlaneXY(0, 0, 0))  # -> Geometry, Transform
boundary_surfaces_3 = BoundarySurfaces(Edges=rotate.Geometry)

bottom_rotate_mid = Slider(62, range=0..360)
bottom_height_2 = Slider(9, range=1..100)
bottom_radius_2 = Slider(13, range=1..200)
bottom_offset = Slider(-19, range=-20..20)
bottom_tilt = Slider(9, range=-20..20)
construct_point_6 = ConstructPoint(XCoordinate=0, YCoordinate=0, ZCoordinate=bottom_height_2)
unit_x_2 = UnitX(Factor=bottom_offset)
circle_cnr_6 = CircleCNR(Center=construct_point_6, Normal=Vector(0, 0, 1), Radius=bottom_radius_2)
move_2 = Move(Geometry=circle_cnr_6, Motion=unit_x_2)  # -> Geometry, Transform
radians_2 = Radians(Degrees=bottom_tilt)
radians_3 = Radians(Degrees=bottom_rotate_mid)
rotate_axis = RotateAxis(Geometry=move_2.Geometry, Angle=radians_2, Axis=Line((0, 0, 0), (10, 0, 0)))  # -> Geometry, Transform
rotate_2 = Rotate(Geometry=rotate_axis.Geometry, Angle=radians_3, Plane=PlaneXY(0, 0, 0))  # -> Geometry, Transform

mid_radius_2 = Slider(13, range=1..200)
mid_offset = Slider(-5, range=-20..20)
mid_height_2 = Slider(57, range=1..100)
mid_tilt = Slider(-16, range=-20..20)
mid_rotate_mid = Slider(136, range=0..360)
construct_point_7 = ConstructPoint(XCoordinate=0, YCoordinate=0, ZCoordinate=mid_height_2)
unit_x_3 = UnitX(Factor=mid_offset)
circle_cnr_7 = CircleCNR(Center=construct_point_7, Normal=Vector(0, 0, 1), Radius=mid_radius_2)
move_3 = Move(Geometry=circle_cnr_7, Motion=unit_x_3)  # -> Geometry, Transform
radians_4 = Radians(Degrees=mid_tilt)
radians_5 = Radians(Degrees=mid_rotate_mid)
rotate_axis_2 = RotateAxis(Geometry=move_3.Geometry, Angle=radians_4, Axis=Line((0, 0, 0), (10, 0, 0)))  # -> Geometry, Transform
rotate_3 = Rotate(Geometry=rotate_axis_2.Geometry, Angle=radians_5, Plane=PlaneXY(0, 0, 0))  # -> Geometry, Transform

mid_top_height = Slider(88, range=1..200)
mid_top_radius = Slider(7, range=1..200)
mid_top_offset = Slider(-9, range=-20..20)
mid_top_tilt = Slider(-11, range=-20..20)
mid_top_rotate_mid = Slider(157, range=0..360)
construct_point_8 = ConstructPoint(XCoordinate=0, YCoordinate=0, ZCoordinate=mid_top_height)
unit_x_4 = UnitX(Factor=mid_top_offset)
circle_cnr_8 = CircleCNR(Center=construct_point_8, Normal=Vector(0, 0, 1), Radius=mid_top_radius)
move_4 = Move(Geometry=circle_cnr_8, Motion=unit_x_4)  # -> Geometry, Transform
radians_6 = Radians(Degrees=mid_top_tilt)
radians_7 = Radians(Degrees=mid_top_rotate_mid)
rotate_axis_3 = RotateAxis(Geometry=move_4.Geometry, Angle=radians_6, Axis=Line((0, 0, 0), (10, 0, 0)))  # -> Geometry, Transform
rotate_4 = Rotate(Geometry=rotate_axis_3.Geometry, Angle=radians_7, Plane=PlaneXY(0, 0, 0))  # -> Geometry, Transform

top_height_2 = Slider(135, range=1..200)
top_radius_2 = Slider(9, range=1..200)
top_offset = Slider(-9, range=-20..20)
top_tilt = Slider(-11, range=-20..20)
top_rotate_mid = Slider(157, range=0..360)
construct_point_9 = ConstructPoint(XCoordinate=0, YCoordinate=0, ZCoordinate=top_height_2)
unit_x_5 = UnitX(Factor=top_offset)
circle_cnr_9 = CircleCNR(Center=construct_point_9, Normal=Vector(0, 0, 1), Radius=top_radius_2)
move_5 = Move(Geometry=circle_cnr_9, Motion=unit_x_5)  # -> Geometry, Transform
radians_8 = Radians(Degrees=top_tilt)
radians_9 = Radians(Degrees=top_rotate_mid)
rotate_axis_4 = RotateAxis(Geometry=move_5.Geometry, Angle=radians_8, Axis=Line((0, 0, 0), (10, 0, 0)))  # -> Geometry, Transform
rotate_5 = Rotate(Geometry=rotate_axis_4.Geometry, Angle=radians_9, Plane=PlaneXY(0, 0, 0))  # -> Geometry, Transform

merge_2 = Merge(
    Data1=rotate.Geometry,
    Data2=rotate_2.Geometry,
    Data3=rotate_3.Geometry,
    Data4=rotate_4.Geometry,
    Data5=rotate_5.Geometry)
loft = Loft(Curves=merge_2, Options={Adjust=False, Closed=False, LoftEnds=0, LoftSimp=0, LoftType=0, Rebuild=10, Refit=0.01})

surface = Surface(boundary_surfaces)

surface_2 = Surface(loft)
cell_seed = Slider(20, range=1..100)
cell_radius = Slider(20, range=0..20)
surface_3 = Surface(surface_2)
surface_4 = Surface(surface_3)

cell_count = Slider(200, range=10..300)

cell_scale = Slider(0.5, range=0.1..1.1)
dimensions = Dimensions(Surface=surface_3)  # -> UDimension, VDimension
plane_surface = PlaneSurface(Plane=PlaneXY(0, 0, 0), XSize=dimensions.UDimension, YSize=dimensions.VDimension)
curve = Curve(plane_surface)
unit_z = UnitZ(Factor=Slider(3, range=1..10))
number_slider = Slider(1, range=1..2)

populate_geometry = PopulateGeometry(Geometry=plane_surface, Count=cell_count, Seed=cell_seed)

voronoi = Voronoi(Points=populate_geometry, Boundary=curve, BruteForceOverride=False)

fillet_2 = Fillet(Curve=voronoi, Radius=cell_radius)

area_3 = Area(Geometry=fillet_2)  # -> Area, Centroid
scale = Scale(Geometry=fillet_2, Center=area_3.Centroid, Factor=cell_scale)  # -> Geometry, Transform
merge_3 = Merge(Data1=scale.Geometry, Data2=curve)  # -> flatten(Result)
boundary_surfaces_4 = BoundarySurfaces(Edges=merge_3)
extrude = Extrude(Base=boundary_surfaces_4, Direction=unit_z)
box = Box(extrude)
surface_morph = SurfaceMorph(
    Geometry=extrude,
    Reference=box,
    Surface=reparameterize(surface_4),
    UDomain=number_slider,
    VDomain=number_slider,
    WDomain=number_slider)  # -> flatten(Geometry)
